# Grasshopper definition sample_extract_table.gh (Grasshopper 1.0.8)
# plug-ins: RhinoCodePluginGH, Saola

initialize = Initialize(Connect=Toggle(True))
panel = Panel()
extract_table = ExtractTable(TableKey="Base Reactions", LoadCombos=panel, ETABSModel=initialize)  # -> Rows, Headers, JSON, ETABSModel
c_script = CSharpScript(rows=extract_table.Rows, headers=extract_table.Headers)  # -> out, A; inputs rows: tree of String, headers: list of String
# ---------- c_script: C# ----------
// Grasshopper Script Instance
#region Usings
using System;
using System.Linq;
using System.Collections;
using System.Collections.Generic;
using System.Drawing;
using Rhino;
using Rhino.Geometry;
using Grasshopper;
using Grasshopper.Kernel;
using Grasshopper.Kernel.Data;
using Grasshopper.Kernel.Types;
#endregion

public class Script_Instance : GH_ScriptInstance
{
    #region Notes
    /* 
      Members:
        RhinoDoc RhinoDocument
        GH_Document GrasshopperDocument
        IGH_Component Component
        int Iteration
      Methods (Virtual & overridable):
        Print(string text)
        Print(string format, params object[] args)
        Reflect(object obj)
        Reflect(object obj, string method_name)
    */
    #endregion

    // Inputs:
    //   rows     — DataTree<string>  connect to ExtractTable [Rows]
    //   headers  — List<string>      connect to ExtractTable [Headers]
    // Output:
    //   A        — string            formatted table, pipe to a Panel

    private void RunScript(
	DataTree<string> rows,
	List<string> headers,
	ref object A)
    {
        if (rows == null || headers == null || headers.Count == 0)
        {
            A = "No data — connect ExtractTable Rows and Headers.";
            return;
        }

        // Collect row data and compute column widths in one pass
        var widths = headers.Select(h => h.Length).ToList();
        var dataRows = new List<List<string>>();

        foreach (var path in rows.Paths)
        {
            var branch = rows.Branch(path);

            var rowData = Enumerable.Range(0, headers.Count)
                .Select(i => i < branch.Count ? (branch[i] ?? string.Empty) : string.Empty)
                .ToList();

            for (int i = 0; i < rowData.Count; i++)
                widths[i] = Math.Max(widths[i], rowData[i].Length);

            dataRows.Add(rowData);
        }

        // Build formatted output
        var sb = new System.Text.StringBuilder();
        const int pad = 2;

        // Header row
        for (int i = 0; i < headers.Count; i++)
            sb.Append(headers[i].PadRight(widths[i] + pad));
        sb.AppendLine();

        // Separator
        for (int i = 0; i < headers.Count; i++)
            sb.Append(new string('─', widths[i]).PadRight(widths[i] + pad));
        sb.AppendLine();

        // Data rows
        foreach (var rowData in dataRows)
        {
            for (int i = 0; i < rowData.Count; i++)
                sb.Append(rowData[i].PadRight(widths[i] + pad));
            sb.AppendLine();
        }

        sb.AppendLine();
        sb.Append($"  {dataRows.Count} row(s)  ·  {headers.Count} column(s)");

        A = sb.ToString();
    }
}
# ---------- end c_script ----------
panel_2 = Panel(c_script.A)
