# Grasshopper definition sample_script.gh (Grasshopper 1.0.8)
# plug-ins: Saola

construct_point = ConstructPoint(XCoordinate=0, YCoordinate=0, ZCoordinate=0)
initialize = Initialize(Connect=Toggle(True))
unit_z = UnitZ(Factor="10")
move = Move(Geometry=construct_point, Motion=unit_z)  # -> Geometry, Transform
line = Line(StartPoint=construct_point, EndPoint=move.Geometry)
draw_frames_by_line = DrawFramesByLine(Lines=line, Sections="ConcBm", ETABSModel=initialize)  # -> FrameNames, ETABSModel
panel = Panel(draw_frames_by_line.FrameNames)
