# Grasshopper definition sample_script_building.gh (Grasshopper 1.0.8)
# plug-ins: RhinoCodePluginGH, Saola

number_slider = Slider(30, range=0..100)
number_slider_2 = Slider(3, range=0..10)
c_script = CSharpScript(
    baysX=number_slider_2,
    baysY=number_slider_2,
    bayWidth=number_slider,
    bayDepth=number_slider,
    stories=Slider(10, range=0..50),
    storyHeight="14",
    inchInput=Toggle(False))  # -> out, columnLines, beamLinesX, beamLinesY, slabVertices, storyNames, storyHeights; inputs baysX: Int32, baysY: Int32, bayWidth: Double, bayDepth: Double, stories: Int32, storyHeight: Double, inchInput: Boolean
# ---------- c_script: C# ----------
// Grasshopper Script Instance
#region Usings
using System;
using System.Linq;
using System.Collections;
using System.Collections.Generic;
using System.Drawing;

using Rhino;
using Rhino.Geometry;

using Grasshopper;
using Grasshopper.Kernel;
using Grasshopper.Kernel.Data;
using Grasshopper.Kernel.Types;
#endregion

public class Script_Instance : GH_ScriptInstance
{
    #region Notes
    /* 
      Members:
        RhinoDoc RhinoDocument
        GH_Document GrasshopperDocument
        IGH_Component Component
        int Iteration

      Methods (Virtual & overridable):
        Print(string text)
        Print(string format, params object[] args)
        Reflect(object obj)
        Reflect(object obj, string method_name)
    */
    #endregion

    private void RunScript(
	int baysX,
	int baysY,
	double bayWidth,
	double bayDepth,
	int stories,
	double storyHeight,
	bool inchInput,
	ref object columnLines,
	ref object beamLinesX,
	ref object beamLinesY,
	ref object slabVertices,
	ref object storyNames,
	ref object storyHeights)
{
    // --- Validate ---
    if (baysX < 1 || baysY < 1 || stories < 1)
    {
        AddRuntimeMessage(GH_RuntimeMessageLevel.Error,
            "baysX, baysY and stories must all be >= 1.");
        return;
    }
    if (bayWidth <= 0 || bayDepth <= 0 || storyHeight <= 0)
    {
        AddRuntimeMessage(GH_RuntimeMessageLevel.Error,
            "bayWidth, bayDepth and storyHeight must be > 0.");
        return;
    }

    // If input is feet → multiply by 12 for Rhino (inches)
    // If input is inches → no conversion needed
    double toRhino = inchInput ? 1.0 : 12.0;

    // For ETABS (kip-ft) → always needs feet
    // If input is inches → divide by 12
    // If input is feet → no conversion needed
    double toEtabs = inchInput ? 1.0 / 12.0 : 1.0;

    int gridX = baysX + 1;
    int gridY = baysY + 1;

    Point3d GridPt(int ix, int iy, int iz) =>
        new Point3d(
            ix * bayWidth    * toRhino,
            iy * bayDepth    * toRhino,
            iz * storyHeight * toRhino);

    // --- Stories (always in feet for ETABS) ---
    var names = new List<string>();
    var heights = new List<double>();
    for (int i = 0; i < stories; i++)
    {
        names.Add($"STORY{i + 1}");
        heights.Add(storyHeight * 12);
    }

    // --- Columns ---
    var cols = new List<Line>();
    for (int iz = 0; iz < stories; iz++)
        for (int ix = 0; ix < gridX; ix++)
            for (int iy = 0; iy < gridY; iy++)
                cols.Add(new Line(GridPt(ix, iy, iz), GridPt(ix, iy, iz + 1)));

    // --- Beams X ---
    var beamsX = new List<Line>();
    for (int iz = 1; iz <= stories; iz++)
        for (int iy = 0; iy < gridY; iy++)
            for (int ix = 0; ix < baysX; ix++)
                beamsX.Add(new Line(GridPt(ix, iy, iz), GridPt(ix + 1, iy, iz)));

    // --- Beams Y ---
    var beamsY = new List<Line>();
    for (int iz = 1; iz <= stories; iz++)
        for (int ix = 0; ix < gridX; ix++)
            for (int iy = 0; iy < baysY; iy++)
                beamsY.Add(new Line(GridPt(ix, iy, iz), GridPt(ix, iy + 1, iz)));

    // --- Slabs ---
    var slabTree = new GH_Structure<GH_Point>();
    int branchIndex = 0;
    for (int iz = 1; iz <= stories; iz++)
    {
        for (int ix = 0; ix < baysX; ix++)
        {
            for (int iy = 0; iy < baysY; iy++)
            {
                var path = new GH_Path(branchIndex++);
                slabTree.Append(new GH_Point(GridPt(ix,     iy,     iz)), path);
                slabTree.Append(new GH_Point(GridPt(ix + 1, iy,     iz)), path);
                slabTree.Append(new GH_Point(GridPt(ix + 1, iy + 1, iz)), path);
                slabTree.Append(new GH_Point(GridPt(ix,     iy + 1, iz)), path);
                slabTree.Append(new GH_Point(GridPt(ix,     iy,     iz)), path);
            }
        }
    }

    // --- Assign outputs ---
    columnLines  = cols;
    beamLinesX   = beamsX;
    beamLinesY   = beamsY;
    slabVertices = slabTree;
    storyNames   = names;
    storyHeights = heights;
}
}
# ---------- end c_script ----------
initialize = Initialize(Connect=Toggle(False))
set_stories = SetStories(StoryNames=c_script.storyNames, StoryHeights=c_script.storyHeights, BaseElevation="0", ETABSModel=initialize)
merge = Merge(Data1=c_script.beamLinesX, Data2=c_script.beamLinesY)
draw_areas = DrawAreas(Vertices=c_script.slabVertices, Sections="Slab1", ETABSModel=set_stories)  # -> AreaNames, ETABSModel
draw_frames_by_line = DrawFramesByLine(Lines=merge, Sections="ConcBm", ETABSModel=set_stories)  # -> FrameNames, ETABSModel
draw_frames_by_line_2 = DrawFramesByLine(Lines=c_script.columnLines, Sections="ConcCol", ETABSModel=set_stories)  # -> FrameNames, ETABSModel
